# Grasshopper definition virtualAgent.gh (Grasshopper 1.0.4)

vec = VectorXYZ(XComponent=Slider(0, range=0..50), YComponent=Slider(0, range=0..50), ZComponent=Slider(0, range=0..50))  # -> Vector, Length
dom = ConstructDomain(DomainStart=Slider(0.301, range=0..1), DomainEnd=Slider(0.352, range=0..1))
msphere = MeshSphere(
    Base=PlaneXY(0, 0, 0),
    Radius=Slider(9.312, range=0..12),
    UCount=Slider(60, range=0..100),
    VCount=Slider(60, range=0..100))
move = Move(Geometry=msphere, Motion=vec.Vector)  # -> Geometry, Transform
mesh = Mesh(move.Geometry)
demesh = DeconstructMesh(Mesh=mesh)  # -> Vertices, Faces, Colours, Normals
lng = ListLength(List=demesh.Vertices)
random = Random(Range=dom, Number=lng, Seed=Slider(19.474, range=0..100))
gate = StreamGate(Stream=demesh.Vertices, Gate=Slider(1, range=0..2))  # -> Target0, Target1, Target2
image = ImageSampler(
    gate.Target2,
    FilePath="/Users/galzemach/School/HCI/ex10/ex10_final/images/rivers_edited.jpg",
    Filter="Value",
    Interpolate=False,
    Umax=30,
    Umin=-30,
    Vmax=30,
    Vmin=-30,
    Wrap=1)
image_2 = ImageSampler(
    gate.Target1,
    FilePath="/Users/galzemach/School/HCI/ex10/ex10_final/images/noise_sqr.png",
    Filter="Value",
    Interpolate=False,
    Umax=30,
    Umin=-30,
    Vmax=30,
    Vmin=-30,
    Wrap=1)
image_3 = ImageSampler(
    gate.Target0,
    FilePath="/Users/galzemach/School/HCI/ex10/ex10_final/images/noise_simplex.png",
    Filter="Value",
    Interpolate=False,
    Umax=30,
    Umin=-30,
    Vmax=30,
    Vmin=-30,
    Wrap=1)
merge = Merge(Data1=image_3, Data2=image_2, Data3=image)
addition = Addition(A=merge, B=random)
multiplication = Multiplication(A=addition, B=Slider(40.951, range=0..100))
moveaway = MoveAwayFrom(Geometry=demesh.Vertices, Emitter=vec.Vector, Distance=multiplication)  # -> Geometry, Transform
conmesh = ConstructMesh(Vertices=moveaway.Geometry, Faces=demesh.Faces)
rotate = Rotate(Geometry=conmesh, Angle=Slider(20.708, range=0..50), Plane=PlaneXY(0, 0, 0))  # -> Geometry, Transform
